# Grasshopper definition LearnCarbon.gh (Grasshopper 1.0.7)

panel = Panel("Location")
panel_2 = Panel("Option A")
panel_3 = Panel("Building Type")
panel_4 = Panel("Option B")
panel_5 = Panel("Total Area")
panel_6 = Panel("Number of Floors")
panel_7 = Panel("Foot Print")
panel_8 = Panel("Type Structure")
panel_9 = Panel("Total Carbon")

lo = Panel("1")
ta = Panel("2000")

ts = Panel("1")
oa = Panel("1")

python = GhPythonScript(StructureType=ts)  # -> out, a; inputs StructureType: Int32
# ---------- python: Python ----------
__author__ = "karimd"
__version__ = "2021.10.31"

import rhinoscriptsyntax as rs


if StructureType == 0:
    a = "Concrete"
if StructureType == 1:
    a = "Steel-Concrete"
if StructureType == 2:
    a = "Wood"
if StructureType == 3:
    a = "Wood-Hybrid"
# ---------- end python ----------
panel_10 = Panel(python.a)
filter = StreamFilter(Gate=oa, Stream0=panel_10)
ot = Panel(filter)
